# Grasshopper definition example.gh (Grasshopper 1.0.7)
# plug-ins: Kangaroo2 Components, MeshQuadrangulation

conmesh = ConstructMesh(Vertices=[Point(0, 0, 0), Point(10, 0, 0), Point(10, 10, 0), Point(0, 10, 0)], Faces={A=0, B=1, C=2, D=3})
triremesh = TriRemesh(Geometry=conmesh, Length=Slider(0.1, range=0..10), Iterations=25)  # -> Triangulation, Dual, Creases
m_quadr = MeshQuadrangulation(Mesh=triremesh.Triangulation, Sources="1")
nv = NakedVertices(Mesh=m_quadr)  # -> ClothedIndex, NakedIndex, ClothedPts, NakedPts
pt = Point(flatten(nv.NakedPts))
m_lpsmth = LaplacianSmooth(Mesh=m_quadr, FixedVertices=pt, Iterations=Slider(50, range=0..50))
mesh = Mesh(m_lpsmth)
